# Grasshopper definition exampleDefinition.gh (Grasshopper 0.9.76)
# plug-ins: Tortuga

material_editor = TortugaMaterialEditor(assembly="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")
multiplication = TortugaMaterialMultiplication(Material=material_editor, Factor=Slider(0.9, range=0..1))
calculator = TortugaCalculator(Material=[multiplication, material_editor], Area=Slider(100, range=0..100))
calculator_result = TortugaCalculatorResult(LCAResult=calculator)  # -> GlobalWarmingPotential, Acidification, DepletionOfNonrenewbles, DepletionOfOzoneLayer, Eutrophication, FormationTroposphericOzone
panel = Panel([calculator_result.GlobalWarmingPotential, calculator_result.Acidification, calculator_result.DepletionOfNonrenewbles, calculator_result.DepletionOfOzoneLayer, calculator_result.Eutrophication, calculator_result.FormationTroposphericOzone])
